# Grasshopper definition Robot1_Robot2_CMD Sync.gh (Grasshopper 1.0.8)
# plug-ins: KUKA|prc - parametric robot control

# ----
# Offset
picking_placing_leading_distance = Slider(500, range=0..1000)
sliver_plcaing_offset = Slider(1500, range=0..10000)

# ----
# Speed Setting
ln_speed = Slider(1, range=0..1)
ln_leadin_speed = Slider(0.5, range=0..2)
rotation_speed = Slider(1, range=0..1)

# ----
# MoveSync Vector Matrix
number_slider = Slider(300, range=0..1000)
unit_z = UnitZ(Factor=number_slider)
unit_y = UnitY(Factor=Slider(300, range=0..1000))
reverse = Reverse(Vector=unit_z)
reverse_2 = Reverse(Vector=unit_y)
merge = Merge(Data1=unit_z, Data2=unit_y, Data3=reverse, Data4=reverse_2)
mass_addition = MassAddition(Input=merge)  # -> Result, PartialResults

unit_z_2 = UnitZ(Factor=picking_placing_leading_distance)
unit_z_3 = UnitZ(Factor=-1)
unit_y_2 = UnitY(Factor=1)
unit_z_4 = UnitZ(Factor=-1)
unit_y_3 = UnitY(Factor=1)
unit_y_4 = UnitY(Factor=sliver_plcaing_offset)
master_picking_point = Point(Point(1862.65395, 1482.531188, 1050.390237))
master_plcaing_point = Point(Point(1339.860244, 2788.93254, 1050.390237))
construct_plane = ConstructPlane(Origin=master_picking_point, XAxis=unit_z_3, YAxis=unit_y_2)
construct_plane_2 = ConstructPlane(Origin=master_plcaing_point, XAxis=unit_z_4, YAxis=unit_y_3)
move = Move(Geometry=construct_plane_2, Motion=unit_y_4)  # -> Geometry, Transform
sliver_plcaing_point = Plane(move.Geometry)
sliver_plcaing_point_2 = Plane(sliver_plcaing_point)
move_2 = Move(Geometry=sliver_plcaing_point_2, Motion=unit_z_2)  # -> Geometry, Transform
move_3 = Move(Geometry=construct_plane, Motion=unit_z_2)  # -> Geometry, Transform
move_4 = Move(Geometry=construct_plane_2, Motion=unit_z_2)  # -> Geometry, Transform

# ----
# RotationSync Motion
rotate_anti_clockwise = Slider(-25, range=-2000..2000)
rotation_center = Slider(0.5, range=0..1)
rotate_clockwise = Slider(25, range=0..100)
accuracy = Slider(20, range=0..100)
construct_domain = ConstructDomain(DomainStart=rotate_clockwise, DomainEnd=rotate_anti_clockwise)
construct_domain_2 = ConstructDomain(DomainStart=rotate_anti_clockwise, DomainEnd="0")
range = Range(Domain=rotate_clockwise, Steps=accuracy)
range_2 = Range(Domain=construct_domain, Steps=accuracy)
range_3 = Range(Domain=construct_domain_2, Steps=accuracy)
line = Line(StartPoint=move_4.Geometry, EndPoint=move_2.Geometry)
evaluate_curve = EvaluateCurve(Curve=reparameterize(line), Parameter=rotation_center)  # -> Point, Tangent, Angle
merge_2 = Merge(Data1=range, Data2=range_2, Data3=range_3)
yz_plane = YZPlane(Origin=evaluate_curve.Point)

trackoffset = Slider(0, range=-2000..2000)
trackoffset_2 = Slider(0, range=-2000..2000)
trackoffset_3 = Slider(400, range=-2000..2000)
trackoffset_4 = Slider(400, range=-2000..2000)
rotate = Rotate(Geometry=move_4.Geometry, Angle=degrees(merge_2), Plane=yz_plane)  # -> Geometry, Transform
trackoffset_5 = Slider(-700, range=-2000..2000)
trackoffset_6 = Slider(-700, range=-2000..2000)
cluster = Cluster(point=move_3.Geometry, B=trackoffset)
trackoffset_7 = Slider(-700, range=-2000..2000)
cluster_2 = Cluster(point=move_4.Geometry, B=trackoffset_2)
rotate_2 = Rotate(Geometry=move_2.Geometry, Angle=degrees(merge_2), Plane=yz_plane)  # -> Geometry, Transform
cluster_3 = Cluster(point=move_2.Geometry, B=trackoffset_5)
wait_kuka_prc = WaitKUKAPrc(KUKAPrcWait=Slider(1, range=0..1))
rotationsync = MoveSync(geometry=move_4.Geometry, transform=rotate.Transform, vel=rotation_speed, trackoffset=trackoffset_3)
movesync = MoveSync(geometry=move_4.Geometry, motion=mass_addition.PartialResults, vel=ln_speed, trackoffset=trackoffset_4)
cluster_4 = MoveSync(geometry=move_2.Geometry, motion=mass_addition.PartialResults, vel=ln_speed, trackoffset=trackoffset_6)
cluster_5 = MoveSync(geometry=move_2.Geometry, transform=rotate_2.Transform, vel=rotation_speed, trackoffset=trackoffset_7)
master_placing_position = LINearMovementKUKAPrc(TargetAsPlane=construct_plane_2, Speed=ln_leadin_speed, extaxenabled=True, interpolation="C_DIS")
sliver_picking_leadin = LINearMovementKUKAPrc(TargetAsPlane=move_2.Geometry, Speed=ln_speed, ExternalAxis1=cluster_3, extaxenabled=True, interpolation="C_DIS")
sliver_picking_position = LINearMovementKUKAPrc(TargetAsPlane=sliver_plcaing_point_2, Speed=ln_leadin_speed, extaxenabled=True, interpolation="C_DIS")
sliver_picking_position_2 = LINearMovementKUKAPrc(TargetAsPlane=sliver_plcaing_point_2, Speed=ln_leadin_speed, extaxenabled=True, interpolation="C_DIS")
axis_move = AXISMovementKUKAPrc(
    Axis1=Slider(-14, range=-180..180),
    Axis2=Slider(-63, range=-180..180),
    Axis3=Slider(108, range=-180..180),
    Axis4=Slider(-6, range=-180..180),
    Axis5=Slider(45, range=-180..180),
    Axis6=Slider(28, range=-180..180),
    Speed=Slider(50, range=0..100),
    ExternalAxis1=Slider(-407, range=-7500..350),
    ExternalAxis2=Slider(0, range=-180..180),
    ExternalAxis3=Slider(0, range=-180..180),
    extaxenabled=True,
    interpolation="C_PTP")
master_picking_leadin = LINearMovementKUKAPrc(TargetAsPlane=move_3.Geometry, Speed=ln_speed, ExternalAxis1=cluster, extaxenabled=True, interpolation="C_DIS")
master_picking_position = LINearMovementKUKAPrc(TargetAsPlane=construct_plane, Speed=ln_leadin_speed, extaxenabled=True, interpolation="C_DIS")
master_picking_leadout = LINearMovementKUKAPrc(TargetAsPlane=move_3.Geometry, Speed=ln_speed, extaxenabled=True, interpolation="C_DIS")
master_placing_leadin = LINearMovementKUKAPrc(TargetAsPlane=move_4.Geometry, Speed=ln_speed, ExternalAxis1=cluster_2, extaxenabled=True, interpolation="C_DIS")
master_placing_position_2 = LINearMovementKUKAPrc(TargetAsPlane=construct_plane_2, Speed=ln_leadin_speed, extaxenabled=True, interpolation="C_DIS")
master_placing_leadout = LINearMovementKUKAPrc(TargetAsPlane=move_4.Geometry, Speed=ln_speed, extaxenabled=True, interpolation="C_DIS")
axis_move_2 = AXISMovementKUKAPrc(
    Axis1=Slider(30, range=-180..180),
    Axis2=Slider(-109, range=-180..180),
    Axis3=Slider(128, range=-180..180),
    Axis4=Slider(-10, range=-180..180),
    Axis5=Slider(59, range=-180..180),
    Axis6=Slider(2, range=-180..180),
    Speed=Slider(50, range=0..100),
    ExternalAxis1=cluster_3,
    ExternalAxis2=Slider(0, range=-180..180),
    ExternalAxis3=Slider(0, range=-180..180),
    extaxenabled=True,
    interpolation="C_PTP")
sliver_picking_leadout = LINearMovementKUKAPrc(TargetAsPlane=move_2.Geometry, Speed=ln_speed, extaxenabled=True, interpolation="C_DIS")
krl_code = KRLCodeKUKAPrc(KRLAsText="BAS(#BASE,1)")
krl_code_2 = KRLCodeKUKAPrc(KRLAsText="LOOP")
krl_code_3 = KRLCodeKUKAPrc(KRLAsText="ENDLOOP")
krl_code_4 = KRLCodeKUKAPrc(KRLAsText="BAS(#BASE,10)")
krl_code_5 = KRLCodeKUKAPrc(KRLAsText="$BASE = BASE_DATA[1]:{X 0, Y 306.19, Z 0, A 0, B 0, C 0}")
krl_code_6 = KRLCodeKUKAPrc(KRLAsText="LOOP")
krl_code_7 = KRLCodeKUKAPrc(KRLAsText="ENDLOOP")
sync = SynchronizeRobotsKUKAPrc(SyncMode="0")
sync_2 = SynchronizeRobotsKUKAPrc(SyncMode="0")
sync_3 = SynchronizeRobotsKUKAPrc(SyncMode="1")
sync_4 = SynchronizeRobotsKUKAPrc(SyncMode="1")
sync_5 = SynchronizeRobotsKUKAPrc(SyncMode="0")
sync_6 = SynchronizeRobotsKUKAPrc(SyncMode="0")
wait = WaitKUKAPrc(KUKAPrcWait=Slider(0.1, range=0..0.1))
wait_2 = WaitKUKAPrc(KUKAPrcWait=Slider(0.1, range=0..0.1))
number_slider_2 = Slider(1, range=0..1)

# ----
# Master_GL
merge_3 = Merge(
    Data1=krl_code,
    Data2=krl_code_2,
    Data4=axis_move,
    Data5=master_picking_leadin,
    Data6=master_picking_position,
    Data7=master_picking_leadout,
    Data8=master_placing_leadin,
    Data9=master_placing_position_2,
    Data10=sync_6,
    Data11=master_placing_position,
    Data12=sync_5,
    Data13=sync_4,
    Data14=master_placing_leadout,
    Data15=movesync,
    Data16=rotationsync,
    Data17=wait,
    Data18=krl_code_3)
kr30_60_ha_robot = KR3060HARobot(infiniterot=False)
geo = Geometry([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])
mjoin = MeshJoin(Meshes=geo)
Y = UnitY(Factor=-1)
geo_2 = Geometry(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)
custom_rail = CustomLinearAxisKUKAPrc(
    KUKAPrcRobotInput=kr30_60_ha_robot,
    RobotRail=geo_2,
    RobotPlatform=mjoin,
    PositiveLength="350",
    NegativeLength="-9670",
    PositiveDirection=Y,
    RobotBase="0,0,480")
dkp400 = DKP400KUKAPrc(
    KUKAPrcRobotInput=custom_rail,
    infiniterot=False,
    root_aval="-90.91",
    root_bval="1.41",
    root_cval="-0.33",
    root_xval="1252.55",
    root_yval="-495.95",
    root_zval="824.58",
    switchedes=True)
kuka_prc = KUKAPrcCORE(
    SimulationSlider=number_slider_2,
    KUKAPrcCommands=merge_3,
    Robot=dkp400,
    SaveToggle=Toggle(False),
    Filename="Bingze1209M",
    PRC_BaseExpose=False,
    PRC_SaveNameExpose=True,
    PRCsettings="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")  # -> RobotGeometry, AnalysisOutput
panel = Panel(kuka_prc.AnalysisOutput)

custom_tool_kuka_prc = CustomToolKUKAPrc(isExternal=False, toolid=0, toolvala=0, toolvalb=0, toolvalc=0, toolvalx=0, toolvaly=0, toolvalz=0, valuesset=True)

# ----
# Seconday_GL
merge_4 = Merge(
    Data1=flatten(krl_code_4),
    Data2=flatten(krl_code_5),
    Data3=flatten(krl_code_6),
    Data4=flatten(axis_move_2),
    Data5=flatten(sync),
    Data6=flatten(sliver_picking_leadin),
    Data7=flatten(sliver_picking_position),
    Data8=flatten(wait_kuka_prc),
    Data9=flatten(sliver_picking_position_2),
    Data10=flatten(sync_2),
    Data11=flatten(sync_3),
    Data12=flatten(sliver_picking_leadout),
    Data13=flatten(cluster_4),
    Data14=flatten(cluster_5),
    Data15=flatten(wait_2),
    Data16=flatten(krl_code_7))
kr30_60_ha_robot_2 = KR3060HARobot(infiniterot=False)
geo_3 = Geometry([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])
mjoin_2 = MeshJoin(Meshes=geo_3)
geo_4 = Geometry(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)
Y_2 = UnitY(Factor=-1)
custom_rail_2 = CustomLinearAxisKUKAPrc(
    KUKAPrcRobotInput=kr30_60_ha_robot_2,
    RobotRail=geo_4,
    RobotPlatform=mjoin_2,
    PositiveLength="350",
    NegativeLength="-9670",
    PositiveDirection=Y_2,
    RobotBase="0,0,480")
dkp400_2 = DKP400KUKAPrc(
    KUKAPrcRobotInput=custom_rail_2,
    infiniterot=False,
    root_aval="-89.9787674",
    root_bval="0.450116187",
    root_cval="0.0542854",
    root_xval="1253.56824",
    root_yval="9808.2041",
    root_zval="831.02",
    switchedes=True)
button = Button()
kuka_prc_2 = KUKAPrcCORE(
    SimulationSlider=number_slider_2,
    KUKAPrcCommands=merge_4,
    Tool=custom_tool_kuka_prc,
    Robot=dkp400_2,
    SaveToggle=Toggle(False),
    Filename="Bingze1209S",
    PRC_BaseExpose=False,
    PRC_SaveNameExpose=True,
    PRCsettings="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")  # -> RobotGeometry, AnalysisOutput

# ==== cluster MoveSync
vel = ClusterInput()
trackoffset = ClusterInput()
motion = ClusterInput()
transform = ClusterInput()
geometry = ClusterInput()
transform_2 = Transform(Geometry=geometry, Transform=transform)
move = Move(Geometry=geometry, Motion=motion)  # -> Geometry, Transform
merge = Merge(Data1=flatten(transform_2), Data2=flatten(move.Geometry))
sync = SynchronizeRobotsKUKAPrc(SyncMode="1")
clean_tree = CleanTree(RemoveNulls=True, RemoveInvalid=True, RemoveEmpty=False, Tree=merge)
cluster = Cluster(point=clean_tree, B=trackoffset)
list_length = ListLength(List=clean_tree)
repeat_data = RepeatData(Data=sync, Length=list_length)
linear_movement_kuka_prc = LINearMovementKUKAPrc(TargetAsPlane=clean_tree, Speed=vel, ExternalAxis1=cluster, extaxenabled=True, interpolation="C_DIS")
weave = Weave(Pattern=[0, 1], Stream0=repeat_data, Stream1=linear_movement_kuka_prc, NullGaps=False)  # -> flatten(Weave)
weave_2 = ClusterOutput(weave)

# ==== cluster Cluster
point = ClusterInput()
B = ClusterInput()
deconstruct = Deconstruct(Point=point)  # -> XComponent, YComponent, ZComponent
negative = Negative(Value=deconstruct.YComponent)
addition = Addition(A=negative, B=B)
result = ClusterOutput(addition)
