# Grasshopper definition Robot1_Robot2_No_Turntable.gh (Grasshopper 1.0.8)
# plug-ins: KUKA|prc - parametric robot control

matching_point = Point(<point referenced from the Rhino model>)
Y = UnitY(Factor=1)
Z = UnitZ(Factor=1)
pl = ConstructPlane(Origin=matching_point, XAxis=Y, YAxis=Z)
Y_2 = UnitY(Factor=Slider(177, range=0..1000))
rev = Reverse(Vector=Y_2)
move = Move(Geometry=pl, Motion=rev)  # -> Geometry, Transform
Y_3 = UnitY(Factor=1)
Z_2 = UnitZ(Factor=1)
rev_2 = Reverse(Vector=Y_3)
rev_3 = Reverse(Vector=Z_2)
matching_point_2 = Point(<point referenced from the Rhino model>)
Z_3 = UnitZ(Factor=Slider(400, range=0..1000))
rev_4 = Reverse(Vector=Z_3)
Z_4 = UnitZ(Factor=Slider(400, range=0..1000))
rev_5 = Reverse(Vector=Z_4)
pl_2 = ConstructPlane(Origin=matching_point_2, XAxis=rev_2, YAxis=rev_3)
number_slider = Slider(303, range=0..1000)
number_slider_2 = Slider(303, range=0..1000)
move_2 = Move(Geometry=pl_2, Motion=Y_2)  # -> Geometry, Transform
move_3 = Move(Geometry=move.Geometry, Motion=Z_3)  # -> Geometry, Transform
move_4 = Move(Geometry=move.Geometry, Motion=rev_4)  # -> Geometry, Transform
move_5 = Move(Geometry=move_2.Geometry, Motion=Z_4)  # -> Geometry, Transform
move_6 = Move(Geometry=move_2.Geometry, Motion=rev_5)  # -> Geometry, Transform
coordinate_with_turntable = Data()  # disabled
krl_code = KRLCodeKUKAPrc(KRLAsText="BAS(#BASE,10)")
krl_code_2 = KRLCodeKUKAPrc(KRLAsText="LOOP")
sync = SynchronizeRobotsKUKAPrc(SyncMode=0)
digital_out = DigitalOutputKUKAPrc(DigitalOutputNumber=number_slider, OutputState=Toggle(True), ContinuousMovement=False, ToolState=-1)
digital_out_2 = DigitalOutputKUKAPrc(DigitalOutputNumber=number_slider, OutputState=Toggle(False), ContinuousMovement=False, ToolState=-1)
axis_move = AXISMovementKUKAPrc(
    Axis1=Slider(30, range=-180..180),
    Axis2=Slider(-112, range=-180..180),
    Axis3=Slider(134, range=-180..180),
    Axis4=Slider(78, range=-180..180),
    Axis5=Slider(57, range=-180..180),
    Axis6=Slider(2, range=-180..180),
    Speed=Slider(10, range=0..10),
    ExternalAxis1=Slider(-9000, range=-9670..-2000),
    ExternalAxis2=Slider(0, range=-180..180),
    ExternalAxis3=Slider(0, range=-180..180),
    extaxenabled=True,
    interpolation="C_PTP")
coordinate_with_turntable_2 = Data()  # disabled
lin_move = LINearMovementKUKAPrc(TargetAsPlane=move.Geometry, ExternalAxis1=Slider(-3500, range=-7500..350), extaxenabled=True, interpolation="C_DIS")
lin_move_2 = LINearMovementKUKAPrc(TargetAsPlane=move_3.Geometry, extaxenabled=True, interpolation="C_DIS")
lin_move_3 = LINearMovementKUKAPrc(TargetAsPlane=move_4.Geometry, extaxenabled=True, interpolation="C_DIS")
lin_move_4 = LINearMovementKUKAPrc(TargetAsPlane=move.Geometry, extaxenabled=True, interpolation="C_DIS")
krl_code_3 = KRLCodeKUKAPrc(KRLAsText="ENDLOOP")
digital_out_3 = DigitalOutputKUKAPrc(DigitalOutputNumber=number_slider_2, OutputState=Toggle(False), ContinuousMovement=False, ToolState=-1)
lin_move_5 = LINearMovementKUKAPrc(TargetAsPlane=move_2.Geometry, ExternalAxis1=Slider(-5589, range=-7500..350), extaxenabled=True, interpolation="C_DIS")
digital_out_4 = DigitalOutputKUKAPrc(DigitalOutputNumber=number_slider_2, OutputState=Toggle(True), ContinuousMovement=False, ToolState=-1)
axis_move_2 = AXISMovementKUKAPrc(
    Axis1=Slider(-33, range=-180..180),
    Axis2=Slider(-112, range=-180..180),
    Axis3=Slider(134, range=-180..180),
    Axis4=Slider(-109, range=-180..180),
    Axis5=Slider(57, range=-180..180),
    Axis6=Slider(28, range=-180..180),
    Speed=Slider(10, range=0..10),
    ExternalAxis1=Slider(0, range=-7500..350),
    ExternalAxis2=Slider(0, range=-180..180),
    ExternalAxis3=Slider(0, range=-180..180),
    extaxenabled=True,
    interpolation="C_PTP")
krl_code_4 = KRLCodeKUKAPrc(KRLAsText="BAS(#BASE,0)")
krl_code_5 = KRLCodeKUKAPrc(KRLAsText="LOOP")
lin_move_6 = LINearMovementKUKAPrc(TargetAsPlane=move_5.Geometry, extaxenabled=True, interpolation="C_DIS")
wait_for = WaitForDigitalInputKUKAPrc(DigitalInput=number_slider)
krl_code_6 = KRLCodeKUKAPrc(KRLAsText="ENDLOOP")
wait_for_2 = WaitForDigitalInputKUKAPrc(DigitalInput=number_slider_2)
lin_move_7 = LINearMovementKUKAPrc(TargetAsPlane=move_6.Geometry, extaxenabled=True, interpolation="C_DIS")
lin_move_8 = LINearMovementKUKAPrc(TargetAsPlane=move_2.Geometry, extaxenabled=True, interpolation="C_DIS")
wait = WaitKUKAPrc(KUKAPrcWait=Slider(0.1, range=0..0.1))
wait_2 = WaitKUKAPrc(KUKAPrcWait=Slider(0.1, range=0..0.1))
merge = Merge(
    Data1=flatten(krl_code),
    Data2=flatten(krl_code_2),
    Data3=flatten(coordinate_with_turntable),
    Data4=flatten(axis_move),
    Data5=flatten(lin_move_5),
    Data6=flatten(sync),
    Data7=flatten(digital_out_4),
    Data8=flatten(wait_for_2),
    Data9=flatten(digital_out_3),
    Data10=flatten(lin_move_6),
    Data11=flatten(lin_move_7),
    Data12=flatten(lin_move_8),
    Data13=flatten(wait_2),
    Data14=flatten(krl_code_6))
merge_2 = Merge(
    Data1=krl_code_4,
    Data2=krl_code_5,
    Data3=coordinate_with_turntable_2,
    Data4=axis_move_2,
    Data5=lin_move,
    Data6=sync,
    Data7=wait_for,
    Data8=digital_out,
    Data9=lin_move_2,
    Data10=digital_out_2,
    Data11=lin_move_3,
    Data12=lin_move_4,
    Data13=wait,
    Data14=krl_code_3)

# ----
# Master_GL
geo = Geometry([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])
number_slider_3 = Slider(0.878, range=0..1)
kr60l30 = KR60L30HARobot(infiniterot=False)
mjoin = MeshJoin(Meshes=geo)
Y_4 = UnitY(Factor=-1)
geo_2 = Geometry(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)
custom_rail = CustomLinearAxisKUKAPrc(
    KUKAPrcRobotInput=kr60l30,
    RobotRail=geo_2,
    RobotPlatform=mjoin,
    PositiveLength="350",
    NegativeLength="-9670",
    PositiveDirection=Y_4,
    RobotBase="0,0,480")
dkp400 = DKP400KUKAPrc(
    KUKAPrcRobotInput=custom_rail,
    infiniterot=False,
    root_aval="-90.91",
    root_bval="1.41",
    root_cval="-0.33",
    root_xval="1252.55",
    root_yval="-495.95",
    root_zval="824.58",
    switchedes=True)
kuka_prc = KUKAPrcCORE(
    SimulationSlider=number_slider_3,
    KUKAPrcCommands=merge_2,
    Robot=dkp400,
    SaveToggle=Toggle(False),
    Filename="bingze_0926",
    PRC_BaseExpose=False,
    PRC_SaveNameExpose=True,
    PRCsettings="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")  # -> RobotGeometry, AnalysisOutput
panel = Panel(kuka_prc.AnalysisOutput)

# ----
# Seconday_GL
number_slider_4 = Slider(0, range=0..1)
geo_3 = Geometry([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])
kr60l30_2 = KR60L30HARobot(infiniterot=False)
mjoin_2 = MeshJoin(Meshes=geo_3)
geo_4 = Geometry(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)
Y_5 = UnitY(Factor=-1)
custom_rail_2 = CustomLinearAxisKUKAPrc(
    KUKAPrcRobotInput=kr60l30_2,
    RobotRail=geo_4,
    RobotPlatform=mjoin_2,
    PositiveLength="350",
    NegativeLength="-9670",
    PositiveDirection=Y_5,
    RobotBase="0,0,480")
dkp400_2 = DKP400KUKAPrc(
    KUKAPrcRobotInput=custom_rail_2,
    infiniterot=False,
    root_aval="-89.9787674",
    root_bval="0.450116187",
    root_cval="0.0542854",
    root_xval="1253.56824",
    root_yval="9808.2041",
    root_zval="831.02",
    switchedes=True)
kuka_prc_2 = KUKAPrcCORE(
    SimulationSlider=number_slider_3,
    KUKAPrcCommands=merge,
    Robot=dkp400_2,
    SaveToggle=Button(),
    Filename="0926_Sliver",
    PRC_BaseExpose=False,
    PRC_SaveNameExpose=True,
    PRCsettings="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")  # -> RobotGeometry, AnalysisOutput

panel_2 = Panel("""9507.782863
-1257.805561
-755.160358
89.9787674
0.0542854
-0.450116187""")
