# Grasshopper definition Robot1_Robot2_Turntable.gh (Grasshopper 1.0.7)
# plug-ins: KUKA|prc - parametric robot control, HAL for Grasshopper

sessionsettings = SessionSettings()  # -> Data, DefaultSettings

# ----
# Fake Base Calculate
vec = Vector(Vector(-0.1853027344, 499.984375, 3.92779541))
vec_2 = Vector(Vector(-499.9997559, -0.181640625, -0.4751586914))
# In Rhino modeling all geomotry use the world coordination system.
crv = Curve(<curve referenced from the Rhino model>)
end = EndPoints(Curve=crv)  # -> Start, End
pl = ConstructPlane(Origin=end.Start, XAxis=vec, YAxis=vec_2)
pl_origin = PlaneOrigin(Base=pl, Origin=end.Start)
deplane = DeconstructPlane(Plane=pl_origin)  # -> Origin, XAxis, YAxis, ZAxis
pl_2 = ConstructPlane(Origin=end.Start, XAxis=deplane.YAxis, YAxis=deplane.ZAxis)
pl_3 = ConstructPlane(Origin=end.Start, XAxis=deplane.XAxis, YAxis=deplane.ZAxis)
pt = Point(end.End)
project = Project(Geometry=pt, Plane=pl_2)  # -> Geometry, Transform
project_2 = Project(Geometry=pt, Plane=pl_origin)  # -> Geometry, Transform
project_3 = Project(Geometry=pt, Plane=pl_3)  # -> Geometry, Transform
dist = Distance(PointA=pt, PointB=project.Geometry)
dist_2 = Distance(PointA=pt, PointB=project_2.Geometry)
negative = Negative(Value=dist_2)
dist_3 = Distance(PointA=pt, PointB=project_3.Geometry)
negative_2 = Negative(Value=dist_3)
base_z = Panel(negative)
base_y = Panel(negative_2)
base_x = Panel(dist)

kr30_60_ha_robot = KR3060HARobot(infiniterot=False)
kr30_60_ha_robot_2 = KR3060HARobot(infiniterot=False)

# ----
# SecondaryRobot
panel = Panel("$BASE=EK(MACHINE_DEF[2].ROOT,MACHINE_DEF[2].MECH_TYPE,BASE_DATA[1])")
Z = UnitZ(Factor=-1)
X = UnitX(Factor=-1)
krl_code = KRLCodeKUKAPrc(KRLAsText="BAS(#BASE,0)")
axis_move = AXISMovementKUKAPrc(
    Axis1=Slider(4, range=-180..180),
    Axis2=Slider(-90, range=-180..180),
    Axis3=Slider(121, range=-180..180),
    Axis4=Slider(-7, range=-180..180),
    Axis5=Slider(27, range=-180..180),
    Axis6=Slider(0, range=-180..180),
    ExternalAxis1=Slider(-2000, range=-9670..-2000),
    extaxenabled=True,
    interpolation="C_PTP")
krl_code_2 = KRLCodeKUKAPrc(KRLAsText=panel)
krl_code_3 = KRLCodeKUKAPrc(KRLAsText="BAS(#BASE,1)")
Y = UnitY(Factor=1)
Z_2 = UnitZ(Factor=1)
rev = Reverse(Vector=Y)
rev_2 = Reverse(Vector=Z_2)
matching_point = Point(<point referenced from the Rhino model>)
Z_3 = UnitZ(Factor=Slider(400, range=0..1000))
rev_3 = Reverse(Vector=Z_3)
pl_4 = ConstructPlane(Origin=matching_point, XAxis=rev, YAxis=rev_2)
number_slider = Slider(303, range=0..1000)
digital_out = DigitalOutputKUKAPrc(DigitalOutputNumber=number_slider, OutputState=Toggle(True), ContinuousMovement=False, ToolState=-1)
digital_out_2 = DigitalOutputKUKAPrc(DigitalOutputNumber=number_slider, OutputState=Toggle(False), ContinuousMovement=False, ToolState=-1)
krl_code_4 = KRLCodeKUKAPrc(KRLAsText="BAS(#BASE,10)")
krl_code_5 = KRLCodeKUKAPrc(KRLAsText="LOOP")
wait_for = WaitForDigitalInputKUKAPrc(DigitalInput=number_slider)
axis_move_2 = AXISMovementKUKAPrc(
    Axis1=Slider(30, range=-180..180),
    Axis2=Slider(-112, range=-180..180),
    Axis3=Slider(134, range=-180..180),
    Axis4=Slider(78, range=-180..180),
    Axis5=Slider(57, range=-180..180),
    Axis6=Slider(2, range=-180..180),
    Speed=Slider(10, range=0..10),
    ExternalAxis1=Slider(-9000, range=-9670..-2000),
    ExternalAxis2=Slider(0, range=-180..180),
    ExternalAxis3=Slider(0, range=-180..180),
    extaxenabled=True,
    interpolation="C_PTP")
krl_code_6 = KRLCodeKUKAPrc(KRLAsText="ENDLOOP")
wait = WaitKUKAPrc(KUKAPrcWait=Slider(0.1, range=0..0.1))

# ----
# MasterRobot
panel_2 = Panel("$BASE=EK(MACHINE_DEF[2].ROOT,MACHINE_DEF[2].MECH_TYPE,BASE_DATA[1])")
approach_pt = Point(<point referenced from the Rhino model>)
leadin_pt = Point(<point referenced from the Rhino model>)
Z_4 = UnitZ(Factor=-1)
X_2 = UnitX(Factor=-1)
pl_5 = ConstructPlane(Origin=leadin_pt, XAxis=Z_4, YAxis=X_2)
pl_6 = ConstructPlane(Origin=approach_pt, XAxis=Z_4, YAxis=X_2)
ptp_move = PTPMovementKUKAPrc(TargetAsPlane=pl_5, ExternalAxis1="0", ExternalAxis2="0", ExternalAxis3="0", extaxenabled=True, interpolation="C_PTP")
lin_move = LINearMovementKUKAPrc(TargetAsPlane=pl_6, Speed="0.2", extaxenabled=False, interpolation="C_DIS")
lin_move_2 = LINearMovementKUKAPrc(TargetAsPlane=pl_6, Speed="0.2", ExternalAxis2=Slider(36, range=0..60), extaxenabled=True, interpolation="C_DIS")
lin_move_3 = LINearMovementKUKAPrc(
    TargetAsPlane=pl_6,
    Speed="0.2",
    ExternalAxis2="30",
    ExternalAxis3=Slider(30, range=0..60),
    extaxenabled=True,
    interpolation="C_DIS")
lin_move_4 = LINearMovementKUKAPrc(
    TargetAsPlane=pl_6,
    Speed="0.2",
    ExternalAxis2=Slider(-25, range=-30..90),
    ExternalAxis3=Slider(0, range=0..60),
    extaxenabled=True,
    interpolation="C_DIS")
lin_move_5 = LINearMovementKUKAPrc(
    TargetAsPlane=pl_6,
    Speed="0.2",
    ExternalAxis2="0",
    ExternalAxis3=Slider(0, range=0..60),
    extaxenabled=True,
    interpolation="C_DIS")
krl_code_7 = KRLCodeKUKAPrc(KRLAsText="BAS(#BASE,0)")
krl_code_8 = KRLCodeKUKAPrc(KRLAsText=panel_2)
krl_code_9 = KRLCodeKUKAPrc(KRLAsText="BAS(#BASE,1)")
merge = Merge(
    Data1=krl_code_9,
    Data2=krl_code_8,
    Data3=ptp_move,
    Data4=lin_move,
    Data5=lin_move_2,
    Data6=lin_move_3,
    Data7=lin_move_4,
    Data8=lin_move_5,
    Data9=ptp_move,
    Data10=krl_code_7)
matching_point_2 = Point(<point referenced from the Rhino model>)
Y_2 = UnitY(Factor=1)
Z_5 = UnitZ(Factor=1)
pl_7 = ConstructPlane(Origin=matching_point_2, XAxis=Y_2, YAxis=Z_5)
Y_3 = UnitY(Factor=Slider(177, range=0..1000))
rev_4 = Reverse(Vector=Y_3)
move = Move(Geometry=pl_7, Motion=rev_4)  # -> Geometry, Transform
Z_6 = UnitZ(Factor=Slider(400, range=0..1000))
rev_5 = Reverse(Vector=Z_6)
number_slider_2 = Slider(303, range=0..1000)
move_2 = Move(Geometry=move.Geometry, Motion=Z_6)  # -> Geometry, Transform
move_3 = Move(Geometry=move.Geometry, Motion=rev_5)  # -> Geometry, Transform
digital_out_3 = DigitalOutputKUKAPrc(DigitalOutputNumber=number_slider_2, OutputState=Toggle(True), ContinuousMovement=False, ToolState=-1)
digital_out_4 = DigitalOutputKUKAPrc(DigitalOutputNumber=number_slider_2, OutputState=Toggle(False), ContinuousMovement=False, ToolState=-1)
lin_move_6 = LINearMovementKUKAPrc(TargetAsPlane=move.Geometry, ExternalAxis1=Slider(-3500, range=-7500..350), extaxenabled=True, interpolation="C_DIS")
lin_move_7 = LINearMovementKUKAPrc(TargetAsPlane=move_2.Geometry, extaxenabled=True, interpolation="C_DIS")
lin_move_8 = LINearMovementKUKAPrc(TargetAsPlane=move_3.Geometry, extaxenabled=True, interpolation="C_DIS")
lin_move_9 = LINearMovementKUKAPrc(TargetAsPlane=move.Geometry, extaxenabled=True, interpolation="C_DIS")
krl_code_10 = KRLCodeKUKAPrc(KRLAsText="ENDLOOP")
axis_move_3 = AXISMovementKUKAPrc(
    Axis1=Slider(-33, range=-180..180),
    Axis2=Slider(-112, range=-180..180),
    Axis3=Slider(134, range=-180..180),
    Axis4=Slider(-109, range=-180..180),
    Axis5=Slider(57, range=-180..180),
    Axis6=Slider(28, range=-180..180),
    Speed=Slider(10, range=0..10),
    ExternalAxis1=Slider(0, range=-7500..350),
    ExternalAxis2=Slider(0, range=-180..180),
    ExternalAxis3=Slider(0, range=-180..180),
    extaxenabled=True,
    interpolation="C_PTP")
krl_code_11 = KRLCodeKUKAPrc(KRLAsText="BAS(#BASE,0)")
krl_code_12 = KRLCodeKUKAPrc(KRLAsText="LOOP")
wait_for_2 = WaitForDigitalInputKUKAPrc(DigitalInput=number_slider_2)
wait_2 = WaitKUKAPrc(KUKAPrcWait=Slider(0.1, range=0..0.1))

pt_2 = Point(leadin_pt)
pt_3 = Point(approach_pt)
pl_8 = ConstructPlane(Origin=pt_2, XAxis=Z, YAxis=X)
pl_9 = ConstructPlane(Origin=pt_3, XAxis=Z, YAxis=X)
ptp_move_2 = PTPMovementKUKAPrc(
    TargetAsPlane=pl_8,
    ExternalAxis1=Slider(-9320, range=-9670..-2000),
    ExternalAxis2="0",
    ExternalAxis3="0",
    extaxenabled=True,
    interpolation="C_PTP")
lin_move_10 = LINearMovementKUKAPrc(TargetAsPlane=pl_9, Speed="0.2", extaxenabled=False, interpolation="C_DIS")
lin_move_11 = LINearMovementKUKAPrc(
    TargetAsPlane=pl_9,
    Speed="0.2",
    ExternalAxis2=Slider(29, range=-90..29),
    ExternalAxis3=Slider(45, range=0..60),
    extaxenabled=True,
    interpolation="C_DIS")
lin_move_12 = LINearMovementKUKAPrc(TargetAsPlane=pl_9, Speed="0.2", ExternalAxis2=Slider(29, range=-90..29), extaxenabled=True, interpolation="C_DIS")
lin_move_13 = LINearMovementKUKAPrc(
    TargetAsPlane=pl_9,
    Speed="0.2",
    ExternalAxis2=Slider(-45, range=-90..29),
    ExternalAxis3=Slider(0, range=0..60),
    extaxenabled=True,
    interpolation="C_DIS")
lin_move_14 = LINearMovementKUKAPrc(
    TargetAsPlane=pl_9,
    Speed="0.2",
    ExternalAxis2="0",
    ExternalAxis3=Slider(0, range=0..60),
    extaxenabled=True,
    interpolation="C_DIS")
merge_2 = Merge(
    Data1=krl_code_3,
    Data2=krl_code_2,
    Data3=ptp_move_2,
    Data4=lin_move_10,
    Data5=lin_move_12,
    Data6=lin_move_11,
    Data7=lin_move_13,
    Data8=lin_move_14,
    Data9=ptp_move_2,
    Data10=krl_code,
    Data11=axis_move)
move_4 = Move(Geometry=pl_4, Motion=Y_3)  # -> Geometry, Transform
move_5 = Move(Geometry=move_4.Geometry, Motion=Z_3)  # -> Geometry, Transform
move_6 = Move(Geometry=move_4.Geometry, Motion=rev_3)  # -> Geometry, Transform
coordinate_with_turntable = Data(merge_2)  # disabled
lin_move_15 = LINearMovementKUKAPrc(TargetAsPlane=move_4.Geometry, ExternalAxis1=Slider(-5589, range=-7500..350), extaxenabled=True, interpolation="C_DIS")
lin_move_16 = LINearMovementKUKAPrc(TargetAsPlane=move_5.Geometry, extaxenabled=True, interpolation="C_DIS")
lin_move_17 = LINearMovementKUKAPrc(TargetAsPlane=move_6.Geometry, extaxenabled=True, interpolation="C_DIS")
lin_move_18 = LINearMovementKUKAPrc(TargetAsPlane=move_4.Geometry, extaxenabled=True, interpolation="C_DIS")
merge_3 = Merge(
    Data1=flatten(krl_code_4),
    Data2=flatten(krl_code_5),
    Data3=flatten(coordinate_with_turntable),
    Data4=flatten(axis_move_2),
    Data5=flatten(lin_move_15),
    Data7=flatten(digital_out),
    Data8=flatten(wait_for),
    Data9=flatten(digital_out_2),
    Data10=flatten(lin_move_16),
    Data11=flatten(lin_move_17),
    Data12=flatten(lin_move_18),
    Data13=flatten(wait),
    Data14=flatten(krl_code_6))

# ----
# Master_EK
kr30_60_ha_robot_3 = KR3060HARobot(infiniterot=False)
geo = Geometry([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])
mjoin = MeshJoin(Meshes=geo)
Y_4 = UnitY(Factor=-1)
geo_2 = Geometry(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)
custom_rail = CustomLinearAxisKUKAPrc(
    KUKAPrcRobotInput=kr30_60_ha_robot_3,
    RobotRail=geo_2,
    RobotPlatform=mjoin,
    PositiveLength="350",
    NegativeLength="-9670",
    PositiveDirection=Y_4,
    RobotBase="0,0,480")
dkp400 = DKP400KUKAPrc(
    KUKAPrcRobotInput=custom_rail,
    infiniterot=False,
    root_aval="-90.91",
    root_bval="1.41",
    root_cval="-0.33",
    root_xval="1252.55",
    root_yval="-495.95",
    root_zval="824.58",
    switchedes=True)
kuka_prc = KUKAPrcCORE(
    SimulationSlider=Slider(0, range=0..1),
    KUKAPrcCommands=merge,
    Robot=dkp400,
    SaveToggle=Toggle(False),
    Filename="Master_DDDD",
    PRC_BaseExpose=False,
    PRC_SaveNameExpose=True,
    PRCsettings="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")  # -> RobotGeometry, AnalysisOutput

# ----
# Secondary_EK
number_slider_3 = Slider(1, range=0..1)
Y_5 = UnitY(Factor=-1)
kl1500_3_rail = KL15003LinearAxisKUKAPrc(
    KUKAPrcRobotInput=kr30_60_ha_robot,
    PositiveLength="-2000",
    NegativeLength="-9670",
    PositiveDirection=Y_5,
    RobotBase="0,0,480")
dkp400_2 = DKP400KUKAPrc(
    KUKAPrcRobotInput=kl1500_3_rail,
    infiniterot=False,
    root_aval="-89.9787674",
    root_bval="0.450116187",
    root_cval="0.0542854",
    root_xval="1253.56824",
    root_yval="9808.2041",
    root_zval="831.02",
    switchedes=True)
kuka_prc_2 = KUKAPrcCORE(
    SimulationSlider=number_slider_3,
    KUKAPrcCommands=flatten(merge_2),
    Robot=dkp400_2,
    SaveToggle=Toggle(False),
    Filename="Sliver_DDDD",
    PRC_BaseExpose=True,
    PRC_SaveNameExpose=True,
    PRCsettings="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")  # -> RobotGeometry, AnalysisOutput

coordinate_with_turntable_2 = Data(merge)  # disabled

merge_4 = Merge(
    Data1=krl_code_11,
    Data2=krl_code_12,
    Data3=coordinate_with_turntable_2,
    Data4=axis_move_3,
    Data5=lin_move_6,
    Data7=wait_for_2,
    Data8=digital_out_3,
    Data9=lin_move_7,
    Data10=digital_out_4,
    Data11=lin_move_8,
    Data12=lin_move_9,
    Data13=wait_2,
    Data14=krl_code_10)

# ----
# Master_GL
geo_3 = Geometry([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])
mjoin_2 = MeshJoin(Meshes=geo_3)
Y_6 = UnitY(Factor=-1)
geo_4 = Geometry(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)
custom_rail_2 = CustomLinearAxisKUKAPrc(
    KUKAPrcRobotInput=kr30_60_ha_robot_2,
    RobotRail=geo_4,
    RobotPlatform=mjoin_2,
    PositiveLength="350",
    NegativeLength="-9670",
    PositiveDirection=Y_6,
    RobotBase="0,0,480")
dkp400_3 = DKP400KUKAPrc(
    KUKAPrcRobotInput=custom_rail_2,
    infiniterot=False,
    root_aval="-90.91",
    root_bval="1.41",
    root_cval="-0.33",
    root_xval="1252.55",
    root_yval="-495.95",
    root_zval="824.58",
    switchedes=True)
kuka_prc_3 = KUKAPrcCORE(
    SimulationSlider=Slider(0, range=0..1),
    KUKAPrcCommands=merge_4,
    Robot=dkp400_3,
    SaveToggle=Toggle(False),
    Filename="Master_DDDD",
    PRC_BaseExpose=False,
    PRC_SaveNameExpose=True,
    PRCsettings="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")  # -> RobotGeometry, AnalysisOutput

# ----
# Seconday_GL
kr30_60_ha_robot_4 = KR3060HARobot(infiniterot=False)
geo_5 = Geometry([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])
mjoin_3 = MeshJoin(Meshes=geo_5)
geo_6 = Geometry(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)
Y_7 = UnitY(Factor=-1)
custom_rail_3 = CustomLinearAxisKUKAPrc(
    KUKAPrcRobotInput=kr30_60_ha_robot_4,
    RobotRail=geo_6,
    RobotPlatform=mjoin_3,
    PositiveLength="350",
    NegativeLength="-9670",
    PositiveDirection=Y_7,
    RobotBase="0,0,480")
dkp400_4 = DKP400KUKAPrc(
    KUKAPrcRobotInput=custom_rail_3,
    infiniterot=False,
    root_aval="-89.9787674",
    root_bval="0.450116187",
    root_cval="0.0542854",
    root_xval="1253.56824",
    root_yval="9808.2041",
    root_zval="831.02",
    switchedes=True)
kuka_prc_4 = KUKAPrcCORE(
    SimulationSlider=Slider(0, range=0..1),
    KUKAPrcCommands=merge_3,
    Robot=dkp400_4,
    SaveToggle=Button(),
    Filename="Sliver_DDDD",
    PRC_BaseExpose=False,
    PRC_SaveNameExpose=True,
    PRCsettings="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")  # -> RobotGeometry, AnalysisOutput
