# Grasshopper definition Robot1_Turntable.gh (Grasshopper 1.0.8)
# plug-ins: KUKA|prc - parametric robot control

# MasterRobot
panel = Panel("$BASE=EK(MACHINE_DEF[2].ROOT,MACHINE_DEF[2].MECH_TYPE,BASE_DATA[1])")
unit_z = UnitZ(Factor=Slider(200, range=0..1000))
pt = Point(Point(0, 0, 242.9562925))
pt_2 = Point(Point(0, 0, 222.5974885))
Z = UnitZ(Factor=-1)
X = UnitX(Factor=-1)
pl = ConstructPlane(Origin=pt, XAxis=Z, YAxis=X)
pl_2 = ConstructPlane(Origin=pt_2, XAxis=Z, YAxis=X)
move = Move(Geometry=pl_2, Motion=unit_z)  # -> Geometry, Transform
ptp_move = PTPMovementKUKAPrc(TargetAsPlane=pl, ExternalAxis1="0", ExternalAxis2="0", ExternalAxis3="0", extaxenabled=True, interpolation="C_PTP")
lin_move = LINearMovementKUKAPrc(TargetAsPlane=pl_2, Speed="0.2", extaxenabled=False, interpolation="C_DIS")
lin_move_2 = LINearMovementKUKAPrc(TargetAsPlane=pl_2, Speed="0.2", ExternalAxis2=Slider(36, range=0..60), extaxenabled=True, interpolation="C_DIS")
lin_move_3 = LINearMovementKUKAPrc(
    TargetAsPlane=move.Geometry,
    Speed="0.2",
    ExternalAxis2="30",
    ExternalAxis3=Slider(30, range=0..60),
    extaxenabled=True,
    interpolation="C_DIS")
lin_move_4 = LINearMovementKUKAPrc(
    TargetAsPlane=pl_2,
    Speed="0.2",
    ExternalAxis2=Slider(-25, range=-30..90),
    ExternalAxis3=Slider(0, range=0..60),
    extaxenabled=True,
    interpolation="C_DIS")
lin_move_5 = LINearMovementKUKAPrc(
    TargetAsPlane=pl_2,
    Speed="0.2",
    ExternalAxis2="0",
    ExternalAxis3=Slider(0, range=0..60),
    extaxenabled=True,
    interpolation="C_DIS")
krl_code = KRLCodeKUKAPrc(KRLAsText="BAS(#BASE,0)")
krl_code_2 = KRLCodeKUKAPrc(KRLAsText=panel)
krl_code_3 = KRLCodeKUKAPrc(KRLAsText="BAS(#BASE,1)")
merge = Merge(
    Data1=krl_code_3,
    Data2=krl_code_2,
    Data3=ptp_move,
    Data4=lin_move,
    Data5=lin_move_2,
    Data6=lin_move_3,
    Data7=lin_move_4,
    Data8=lin_move_5,
    Data9=ptp_move,
    Data10=krl_code)

# ----
# Master_EK
number_slider = Slider(0.962, range=0..1)
kr60l30 = KR60L30HARobot(infiniterot=False)
Y = UnitY(Factor=-1)
panel_2 = Panel("-7500")
kl1500_3_rail = KL15003LinearAxisKUKAPrc(KUKAPrcRobotInput=kr60l30, PositiveLength="350", NegativeLength="-7500", PositiveDirection=Y, RobotBase="0,0,480")
dkp400 = DKP400KUKAPrc(
    KUKAPrcRobotInput=kl1500_3_rail,
    infiniterot=False,
    root_aval="-90.91",
    root_bval="1.41",
    root_cval="-0.33",
    root_xval="1252.55",
    root_yval="-495.95",
    root_zval="824.58",
    switchedes=True)
kuka_prc = KUKAPrcCORE(
    SimulationSlider=number_slider,
    KUKAPrcCommands=merge,
    Robot=dkp400,
    SaveToggle=Toggle(False),
    Filename="ucl_0926",
    PRC_BaseExpose=False,
    PRC_SaveNameExpose=True,
    PRCsettings="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")  # -> RobotGeometry, AnalysisOutput
