# Grasshopper definition Robot2_Turntable.gh (Grasshopper 1.0.8)
# plug-ins: KUKA|prc - parametric robot control

# SecondaryRobot
panel = Panel("$BASE=EK(MACHINE_DEF[2].ROOT,MACHINE_DEF[2].MECH_TYPE,BASE_DATA[1])")
pt = Point(<point referenced from the Rhino model>)
pt_2 = Point(<point referenced from the Rhino model>)
unit_y = UnitY(Factor="200")
pt_3 = Point(pt_2)
pt_4 = Point(pt)
Z = UnitZ(Factor=-1)
X = UnitX(Factor=-1)
pl = ConstructPlane(Origin=pt_3, XAxis=Z, YAxis=X)
pl_2 = ConstructPlane(Origin=pt_4, XAxis=Z, YAxis=X)
move = Move(Geometry=pl_2, Motion=unit_y)  # -> Geometry, Transform
ptp_move = PTPMovementKUKAPrc(
    TargetAsPlane=pl,
    ExternalAxis1=Slider(-9320, range=-9670..-2000),
    ExternalAxis2="0",
    ExternalAxis3="0",
    extaxenabled=True,
    interpolation="C_PTP")
lin_move = LINearMovementKUKAPrc(TargetAsPlane=pl_2, Speed="0.2", extaxenabled=False, interpolation="C_DIS")
lin_move_2 = LINearMovementKUKAPrc(TargetAsPlane=pl_2, Speed="0.2", ExternalAxis2=Slider(25, range=-90..29), extaxenabled=True, interpolation="C_DIS")
lin_move_3 = LINearMovementKUKAPrc(TargetAsPlane=move.Geometry, Speed="0.2", extaxenabled=False, interpolation="C_DIS")
lin_move_4 = LINearMovementKUKAPrc(
    TargetAsPlane=move.Geometry,
    Speed="0.2",
    ExternalAxis2=Slider(25, range=-90..29),
    ExternalAxis3=Slider(60, range=0..60),
    extaxenabled=True,
    interpolation="C_DIS")
lin_move_5 = LINearMovementKUKAPrc(
    TargetAsPlane=pl_2,
    Speed="0.2",
    ExternalAxis2=Slider(-25, range=-90..29),
    ExternalAxis3=Slider(0, range=0..60),
    extaxenabled=True,
    interpolation="C_DIS")
lin_move_6 = LINearMovementKUKAPrc(
    TargetAsPlane=pl_2,
    Speed="0.2",
    ExternalAxis2="0",
    ExternalAxis3=Slider(0, range=0..60),
    extaxenabled=True,
    interpolation="C_DIS")
axis_move = AXISMovementKUKAPrc(
    Axis1=Slider(4, range=-180..180),
    Axis2=Slider(-90, range=-180..180),
    Axis3=Slider(121, range=-180..180),
    Axis4=Slider(-7, range=-180..180),
    Axis5=Slider(27, range=-180..180),
    Axis6=Slider(0, range=-180..180),
    ExternalAxis1=Slider(-7500, range=-9670..-2000),
    extaxenabled=True,
    interpolation="C_PTP")
krl_code = KRLCodeKUKAPrc(KRLAsText="BAS(#BASE,1)")
krl_code_2 = KRLCodeKUKAPrc(KRLAsText=panel)
krl_code_3 = KRLCodeKUKAPrc(KRLAsText="BAS(#BASE,0)")
merge = Merge(
    Data1=krl_code,
    Data2=krl_code_2,
    Data3=ptp_move,
    Data4=lin_move,
    Data5=lin_move_2,
    Data6=lin_move_3,
    Data7=lin_move_4,
    Data8=lin_move_5,
    Data9=lin_move_6,
    Data10=ptp_move,
    Data11=krl_code_3,
    Data12=axis_move)

# ----
# Secondary_EK
number_slider = Slider(0.95, range=0..1)
kr60l30 = KR60L30HARobot(infiniterot=False)
Y = UnitY(Factor=-1)
kl1500_3_rail = KL15003LinearAxisKUKAPrc(KUKAPrcRobotInput=kr60l30, PositiveLength="-2000", NegativeLength="-9670", PositiveDirection=Y, RobotBase="0,0,480")
dkp400 = DKP400KUKAPrc(
    KUKAPrcRobotInput=kl1500_3_rail,
    infiniterot=False,
    root_aval="-89.9787674",
    root_bval="0.450116187",
    root_cval="0.0542854",
    root_xval="1253.56824",
    root_yval="9808.2041",
    root_zval="831.02",
    switchedes=True)
kuka_prc = KUKAPrcCORE(
    SimulationSlider=number_slider,
    KUKAPrcCommands=flatten(merge),
    Robot=dkp400,
    SaveToggle=Toggle(False),
    Filename="bingze_0926",
    PRC_BaseExpose=True,
    PRC_SaveNameExpose=True,
    PRCsettings="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")  # -> RobotGeometry, AnalysisOutput
